# Grasshopper definition labACD-RecursiveFunctions-CSharp-v3.gh (Grasshopper 1.0.7)
# plug-ins: Bifocals

pt = Point(<point referenced from the Rhino model>)
# FAB16 MTL
# Lab adc
# Workshop : Jam Coding " Recursive Functions "
# // Andres Obregon
# // C# Recursive Function
pt_2 = Point(<point referenced from the Rhino model>)
c_script = CSharpScript(a=pt_2, b=pt, t=Slider(0.2, range=0..1))  # -> out, A, B; inputs a: Point3d, b: Point3d, t: Double
# ---------- c_script: C# ----------
    Print("Hello World!");
   // Point3d a = new Point3d(0, 10, 0);
   // Point3d b = new Point3d(10, 10, 0);

    Line ln0 = new Line(a, b);
    Point3d ptT = ln0.PointAt(t);

    A = ln0;
    B = ptT;
# ---------- end c_script ----------
panel = Panel(c_script.out)

# ----
# //- Function to Make a Polyline from a List of Points
toggle = BooleanToggle(False)
pt_3 = Point([<point referenced from the Rhino model> x8])
c_script_2 = CSharpScript(points=pt_3, close=toggle)  # -> out, A; inputs points: list of Point3d, close: Boolean
# ---------- c_script_2: C# ----------
    // Lab adc, Jam Coding " Recursive Function" FAB16 MTL
    // C# Code by Andres Obregon

    Print("Hello FAB16 !");





    A = MakePolyline(points, close);
# ---------- c_script_2: C# additional code ----------
  //- Function to Make a Polyline from a List of Points
  Polyline MakePolyline(List<Point3d> points, bool close)
  {
    if(close)
    {
      // Close the Polyline, Add the first Point at the end of the List
      points.Add(points[0]);
    }
    //- Make a Polyline
    Polyline poly = new Polyline(points);

    return poly;
  }
# ---------- end c_script_2 ----------
crv = Curve(c_script_2.A)
panel_2 = Panel(c_script_2.out)

# ----
# //- Function to Make a Polyline from a List of Points
# //- Make a List of Points At(t) foreach segment Line
toggle_2 = BooleanToggle(True)
pt_4 = Point([<point referenced from the Rhino model> x8])
c_script_3 = CSharpScript(points=pt_4, close=toggle_2, t=Slider(0.6, range=0..1))  # -> out, A, B; inputs points: list of Point3d, close: Boolean, t: Double
# ---------- c_script_3: C# ----------
    // Lab adc, Jam Coding " Recursive Function" FAB16 MTL
    // C# Code by Andres Obregon

    Print("Hello FAB16 !");
    //- Call our function to Make the first Polyline from a List of Points
    Polyline firstPolyline = MakePolyline(points, close);
    //- Make a List of Points At (t) parameter for each segment Line
    List<Point3d> newPoints = MakePointsAt(firstPolyline, t);

     // Outputs
    A = firstPolyline;
    B = newPoints;
# ---------- c_script_3: C# additional code ----------
  //- Function to Make a Polyline from a List of Points
  Polyline MakePolyline(List<Point3d> points, bool close)
  {
    if(close)
    {
      // Close the Polyline, Add the first Point at the end of the List
      points.Add(points[0]);
    }
    //- Make a Polyline
    Polyline poly = new Polyline(points);

    return poly;
  }

  //- Make a List of Points At(t) foreach segment Line
  List<Point3d> MakePointsAt (Polyline firstPolyline, double t)
  {
    // Empty List to collect the Points
    List<Point3d> newPoints = new List<Point3d>();

    Print(firstPolyline.SegmentCount.ToString());

    for(int i = 0; i < firstPolyline.SegmentCount; i++)
    {
      Line[] lines = new Line[]{};
      lines = firstPolyline.GetSegments();
      newPoints.Add(lines[i].PointAt(t) );
    }

    return newPoints;
  }
# ---------- end c_script_3 ----------
crv_2 = Curve(c_script_3.A)
panel_3 = Panel(c_script_3.out)

# ----
# List<Point3d>
pt_5 = Point([<point referenced from the Rhino model> x8])

# ----
# // Repetition in a Recursion Function
number_slider = Slider(33, range=0..110)
pt_6 = Point([<point referenced from the Rhino model> x8])
c_script_4 = CSharpScript(points=pt_6, close=Toggle(True), t=Slider(0.7, range=0..1), n=number_slider)  # -> out, A, B, C; inputs points: list of Point3d, close: Boolean, t: Double, n: Int32
# ---------- c_script_4: C# ----------
    // Lab adc, Jam Coding " Recursive Function" FAB16 MTL
    // C# Code by Andres Obregon

    Print("Hello FAB16 !");
    //- Declare and empty List to collect all the Polylines
    List<Polyline> newPolylines = new List<Polyline>();
    //-----------------------------------------------------------------------
    //- Call our function to Make the first Polyline from a List of Points
    Polyline firstPolyline = MakePolyline(points, close);
    //- Make a List of Points At (t) parameter for each segment Line
    //List<Point3d> newPoints = MakePointsAt(firstPolyline, t);
    
    //- Add to our List of Polylinew the first Polyline
    newPolylines.Add(firstPolyline);
    
    // Outputs
    //A = firstPolyline;
    //B = newPoints;
    
    C = PolylineRecursiveLoop(newPolylines, close, n, t);
# ---------- c_script_4: C# additional code ----------
  //- Function to Make a Polyline from a List of Points
  Polyline MakePolyline(List<Point3d> points, bool close)
  {
    if(close)
    {
      // Close the Polyline, Add the first Point at the end of the List
      points.Add(points[0]);
    }
    //- Make a Polyline
    Polyline poly = new Polyline(points);

    return poly;
  }

  //- Make a List of Points At(t) foreach segment Line
  List<Point3d> MakePointsAt (Polyline firstPolyline, double t)
  {
    // Empty List to collect the Points
    List<Point3d> newPoints = new List<Point3d>();

    //Print(firstPolyline.SegmentCount.ToString());

    for(int i = 0; i < firstPolyline.SegmentCount; i++)
    {
      Line[] lines = new Line[]{};
      lines = firstPolyline.GetSegments();
      newPoints.Add(lines[i].PointAt(t));
    }

    return newPoints;
  }

  // Make a Recursion Function to generete a List of n Polylines inside an input Polyline
  List <Polyline> PolylineRecursiveLoop(List <Polyline> newPolylines, bool close, int nRepetitions, double t)
  {
    Polyline firstPolyline = newPolylines[newPolylines.Count - 1];// Add the first Polyline
    
    //- Call our funciton to Make a List of Points At(t) parameter foreach segment Line of the Polyline
    List<Point3d> newPoints = MakePointsAt(firstPolyline, t); // store this in a variable List points
    
    //- Call our function to Make a Polyline from the List of Points
    Polyline newPoly = MakePolyline(newPoints, close);
    
    //- Add the new Polyline to the List
    newPolylines.Add(newPoly);
    
    //- Decrement numbers of repetitions
    nRepetitions = nRepetitions - 1;
    
    //- Get all the segments lines of the polyline into the array of lines
    Line[] lines = newPoly.GetSegments();
    
    // Condition to minimum segment Length--------------------------------------------
    double minimumLength = 0.5; // Define the minimum segment dimension
    for (int i = 0; i < newPoly.SegmentCount; i++)
    {
      if (lines[i].Length <= minimumLength)
        return newPolylines;
    }
     //---------------------------------------------------------------------------------
    
    //- Condition to check if we have just one line segment in a open Polyline
    if(newPoints.Count <= 2)
    {
      return newPolylines;
    }
    
    //- Condition to stop the repetiont
    if(nRepetitions >= 1)
    {
      Print("Lets call again the PolylineRecursiveLoop function");
      firstPolyline = newPoly;
      newPoints.Clear();
      
      //-RECURSIVE function Call again the PolylineRecursiveLoop
      PolylineRecursiveLoop(newPolylines, close, nRepetitions, t);
    }
    
   
    return newPolylines;
  }
# ---------- end c_script_4 ----------
panel_4 = Panel(c_script_4.C)
crv_3 = Curve(c_script_4.A)
pt_7 = Point(c_script_4.B)
panel_5 = Panel(c_script_4.out)

c_script_5 = CSharpScript(points=pt_5, t=Slider(0.7, range=0..1))  # -> out, A, B; inputs points: list of Point3d, t: Double
# ---------- c_script_5: C# ----------
    Print("Hello World!");
   

    Point3d a = points[0]; // first point
    Point3d b = points[1]; // second point
    
    Line ln0 = new Line(a, b);
    Point3d ptT = ln0.PointAt(t);
    
    A = ln0;
    B = ptT;
# ---------- end c_script_5 ----------
pt_8 = Point(c_script_3.B)
panel_6 = Panel(c_script_5.out)
panel_7 = Panel(pt_8)

number_slider_2 = Slider(0.6, range=0..1)
toggle_3 = BooleanToggle(True)
pt_9 = Point([<point referenced from the Rhino model> x8])

c_script_6 = CSharpScript(points=pt_9, close=toggle_3, t=number_slider_2)  # -> out, A, B; inputs points: list of Point3d, close: Boolean, t: Double; same code as c_script_3
crv_4 = Curve(c_script_6.A)
pt_10 = Point(c_script_6.B)

c_script_7 = CSharpScript(points=pt_10, close=toggle_3, t=number_slider_2)  # -> out, A, B; inputs points: list of Point3d, close: Boolean, t: Double; same code as c_script_3
crv_5 = Curve(c_script_7.A)
pt_11 = Point(c_script_7.B)

c_script_8 = CSharpScript(points=pt_11, close=toggle_3, t=number_slider_2)  # -> out, A, B; inputs points: list of Point3d, close: Boolean, t: Double; same code as c_script_3
crv_6 = Curve(c_script_8.A)
pt_12 = Point(c_script_8.B)
