# Grasshopper definition labADC-Repetion-NesteLoop.gh (Grasshopper 1.0.7)

crv = Curve(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)
c_script = CSharpScript(polyline=crv, t=Slider(0.29, range=0..1), n=Slider(7, range=0..10))  # -> out, A; inputs polyline: Polyline, t: Double, n: Int32
# ---------- c_script: C# ----------
    A = PolySubdivision(polyline, n, t);
# ---------- c_script: C# additional code ----------
  // C# code by Andres Obregon

  List<Polyline> PolySubdivision (Polyline initialPolyline, int repetitions, double t)
  {
    // Empty List to collect the Polylines
    List < Polyline > polylines = new List<Polyline> ();
    if(t > 1){t = 1;} if (t < 0){t = 0;} //t (0.0 to 1.0)
    polylines.Add(initialPolyline);
    Polyline firstPolyline = initialPolyline;

    List<Point3d> ptSegment = new List<Point3d>();

    int nPolySegments = initialPolyline.Count - 1;
    Print(nPolySegments.ToString());

    for (int k = 0; k < repetitions ; k++)
    {


      // Segments Array
      Line [] rSegments = new Line [nPolySegments];
      rSegments = firstPolyline.GetSegments();


      // Point3d Segments
      for (int j = 0; j < rSegments.Length; j++)
      {
        //Print("segement");
        ptSegment.Add(rSegments[j].PointAt(t));
        // Add first Point to close the Polyline
      }

      ptSegment.Add(ptSegment[0]); // ClosePolyline

      // Draw the Polyline
      Polyline secondPoly = new Polyline(ptSegment);
      // Add the new Polyline to the List
      polylines.Add(secondPoly);
      // Update the firt Polyline
      firstPolyline = secondPoly;
      //Clear the list of points
      ptSegment.Clear();

    }


    return polylines;
  }
# ---------- end c_script ----------
crv_2 = Curve(c_script.A)
panel = Panel(crv_2)
